# Grasshopper definition TestScript.gh (Grasshopper 1.0.7)

c_script = CSharpScript(
    run=Toggle(False),
    reset=Button(),
    Reference="C:\Users\nicol\source\repos\SharpMatter\SharpMatter\obj\Debug\SharpMatter.dll")  # -> out, A; inputs run: Boolean, reset: Boolean
# ---------- c_script: C# usings ----------
using SharpMatter.SharpGeometry;
using SharpMatter.SharpParticle;
# ---------- c_script: C# ----------
    List<Point3d> pos = new List<Point3d>();

    if(run)
    {
      foreach (SharpParticle item in particles)
      {
        item.Update(new Vec3(1, 2, 0));
        pos.Add((Point3d) item.position);

      }
      Component.ExpireSolution(true);
    }

    if(reset)
    {
      particles.Clear();

      for (int i = 0; i < 10; i++)
      {
        SharpParticle p = new SharpParticle(Vec3.VectorRandomDistribution(0, 10, 0, 10, 0, 0), Vec3.Zero(), Vec3.Vector2dRandom(), 0.05, 0.05, 1);
        particles.Add(p);
      }


    }

    A = pos;
# ---------- c_script: C# additional code ----------
  List<SharpParticle> particles = new List<SharpParticle>();
# ---------- end c_script ----------
